# Grasshopper definition Demo Throttle pedal.gh (Grasshopper 0.9.76)
# plug-ins: Python Interpreter, horsterReference, Human UI

# ----
# Window creation
number_slider = Slider(593, range=0..1000)
launchwin = LaunchWindow(
    Show=Toggle(True),
    Name="Throttle pedal",
    Width=Slider(524, range=1..1000),
    Height=number_slider,
    ChildStatus=0,
    EnableHorizScroll=False)

panel = Panel("""A
b
c
d""")
python = PythonScript(layernames=panel)  # -> out, D
# ---------- python: Python ----------
# Import GH core library to use DataTree in Python
import rhinoscriptsyntax as rs
import clr
clr.AddReference("Grasshopper")
import Grasshopper.Kernel.Data.GH_Path as ghpath
import Grasshopper.DataTree as datatree
import System
import math

D = datatree[System.Object]()
# ---------- end python ----------
label = CreateLabel(LabelText="gh", LabelSize=12, Justification=0)
listbox = CreateListBox(ListItems=panel, SelectedIndex=0, Height=Slider(28, range=0..100))
panel_2 = Panel(label)
panel_3 = Panel(python.out)
datatable = CreateDataTable(Data=label, ColumnHeadings=panel_3, AllowSorting=True, ColumnSizingMode=-1)

panel_4 = Panel("""256, 98, 165
298, 250, 200
100, 280, 50
50, 180, 100""")
panel_5 = Panel("""This is a presentation of the model lever in 3D.
Its color can be modify by selecting color in the picker.
The model can also be rotate.""")
colorpicker = CreateColorPicker(DefaultColor="110,110,255", AvailableColors=panel_4)
label_2 = CreateLabel(LabelText=panel_5, LabelSize=Slider(16, range=0..100), Justification=Slider(0, range=0..3))
label_3 = CreateLabel(LabelText="Lever 3D model", LabelSize=Slider(7, range=1..100), Justification=Slider(3, range=1..3))

# ----
# Color component
values = ValueListener(Elements=colorpicker, SomeProperty=True)  # -> Values, Indices
panel_6 = Panel(values.Values)
geo = Geometry(<brep referenced from the Rhino model>)
preview = CustomPreview(Geometry=geo, Shader=panel_6)
_3dview = Create3DView(MeshToDisplay=geo, MeshColors=panel_6, ViewWidth=Slider(245, range=0..1000), ViewHeight=Slider(395, range=0..1000))

id = Guid(geo)
readattributes = ReadObjectAttributes(ObjectGuid=id)  # -> Name, Layer, Color, Type, Material
bbbox_dimension = PythonScript(input=geo)  # -> x, y, z
# ---------- bbbox_dimension: Python ----------
import rhinoscriptsyntax as rs
import scriptcontext as sc
import Rhino, System


def SetGhostedObjDisplayModeAllViewports(objIDs):
    if isinstance(objIDs,System.Guid): objIDs=[objIDs]
    modeName="Ghosted"
    dModes = Rhino.Display.DisplayModeDescription.GetDisplayModes()
    modeNames=[dMode.LocalName for dMode in dModes if not dMode.PipelineLocked]
    
    index=-1
    for i in range(len(modeNames)):
        if modeName==modeNames[i]:
            index=i ; break
    if index==-1: return
        
    vIDs=[view.ActiveViewportID for view in sc.doc.Views]
    for vID in vIDs:
        for objID in objIDs:
            objRef=sc.doc.Objects.Find(objID)
            attr = objRef.Attributes
            attr.SetDisplayModeOverride(dModes[i], vID)
            sc.doc.Objects.ModifyAttributes(objID, attr, False)
    
def BoundingBoxWithSize(obj):
    bb = rs.BoundingBox(obj)
    if not bb:
        print err_msg ; return
    
    prec = sc.doc.DistanceDisplayPrecision
    tol = sc.doc.ModelAbsoluteTolerance
    sc.doc.ModelUnitSystem
    unit_sys = sc.doc.ModelUnitSystem
    unit_name=Rhino.RhinoDoc.ActiveDoc.GetUnitSystemName(True,False,True,True)
    
    XL = bb[1].DistanceTo(bb[0])
    YL = bb[3].DistanceTo(bb[0])
    ZL = bb[4].DistanceTo(bb[0])
    
    #2d/3d/NoD check
    isX = 1 ; isY = 1 ; isZ = 1
    if XL < tol: isX = 0
    if YL < tol: isY = 0
    if ZL < tol: isZ = 0
    if isX+isY+isZ < 2:
        #two or more 0 length sides
        print(err_msg) ; return
    
    vol=False
    if XL < tol: av_calc = YL * ZL
    elif YL < tol: av_calc = XL * ZL
    elif ZL < tol: av_calc = XL * YL
    else:
        av_calc = XL * YL * ZL
        vol=True
        
    XMpt = (bb[0]+bb[1])/2
    YMpt = (bb[0]+bb[3])/2
    ZMpt = (bb[0]+bb[4])/2
    
    str_xl = "" ; str_yl = "" ; str_zl = ""
    if isX > 0: str_xl = "X " + str(round(XL, prec))
    if isY > 0: str_yl = "Y " + str(round(YL, prec))
    if isZ > 0: str_zl = "Z " + str(round(ZL, prec))
        
    rs.EnableRedraw(False)
    group=[]
    if vol :
        group.append(rs.AddBox(bb))
        rs.SurfaceIsocurveDensity(group[0], -1)
        SetGhostedObjDisplayModeAllViewports(group[0])
    else:
        if not isX:
            group.append(rs.AddPolyline([bb[0], bb[3], bb[7], bb[4], bb[0]]))
        elif not isY:
            group.append(rs.AddPolyline([bb[0], bb[1], bb[5], bb[4], bb[0]]))
        elif not isZ:
            group.append(rs.AddPolyline([bb[0], bb[1], bb[2], bb[3], bb[0]]))
    
#    if isX: group.append(rs.AddTextDot(str_xl, XMpt))
#    if isY: group.append(rs.AddTextDot(str_yl, YMpt))
#    if isZ: group.append(rs.AddTextDot(str_zl, ZMpt))

#    grp_name = rs.AddGroup()
#    rs.AddObjectsToGroup(group, grp_name)
#    rs.ObjectColor(group, System.Drawing.Color.Black)
    
    if vol:
        desc="volume" ; sqcu="cubic "
    else:
        desc="area" ; sqcu="sq. "
    AV = " || {}: {} {}{}".format(desc,round(av_calc, prec),sqcu,unit_name)

    if str_xl: str_xl = " | " + str_xl
    if str_yl: str_yl = " | " + str_yl
    if str_zl: str_zl = " | " + str_zl
    print "Bounding box size:{}{}{}{}".format(str_xl,str_yl,str_zl,AV)
    
    return ([round(XL, prec), round(YL, prec), round(ZL, prec)])

a = BoundingBoxWithSize(input)
x=a[0]
y=a[1]
z=a[2]
# ---------- end bbbox_dimension ----------
panel_7 = Panel([readattributes.Name, readattributes.Material, bbbox_dimension.x, bbbox_dimension.y, bbbox_dimension.z])

# ----
# Adjust Element Appearance
number_slider_2 = Slider(24, range=0..100)
swatch = Red(SwatchColor=RGB(3, 177, 0))
swatch_2 = White(SwatchColor=RGB(244, 255, 255))
adjustelem = AdjustElementAppearance(ElementsToAdjust=label_3, Foreground=swatch, Background=swatch_2, FontSize=number_slider_2)

create_label = CreateLabel(LabelText=panel_7, LabelSize=Slider(16, range=0..100), Justification=Slider(2, range=0..10))

merge = Merge(Data1=label_3, Data2=colorpicker, Data3=label_2, Data4=_3dview, Data7=create_label)

tabbed_view = TabbedView(TabNames="Test Tab", TabTextSize=Slider(38, range=0..1000), Tab0=flatten(merge))
addelems = AddElements(Window=launchwin, Elements=flatten(tabbed_view), DoVLChecking=True)  # -> AddedElements, ElementNames
